# Grasshopper definition CA_3d.gh (Grasshopper 1.0.7)
# plug-ins: Pufferfish, Anemone, MeshEdit Components

sizez = Slider(1, range=0.1..10)
gameoflife = ConwaysGameOfLife(
    Max=Slider(33, range=1..100),
    Wrap=Toggle(True),
    Rec=Toggle(True),
    Seed=Slider(88, range=1..100),
    Reset=Button(),
    Run=Toggle(True))  # -> out, Count, Cells, States, Ages; inputs Plane: Plane, ExtendX: Int32, ExtendY: Int32, Max: Int32, Wrap: Boolean, Rec: Boolean, Reset: Boolean, Run: Boolean
# ---------- gameoflife: Python ----------
"""Pythonic Conway's Game of Life Algorithm.
    ---
    The Game of Life, also known simply as Life, is a cellular automaton
    devised by the British mathematician John Horton Conway in 1970.
    The game is a zero-player game, meaning that its evolution is determined 
    by its initial state, requiring no further input. One interacts with the 
    Game of Life by creating an initial configuration and observing how it 
    evolves, or, for advanced players, by creating patterns with particular 
    properties.
    ---
    See also https://en.wikipedia.org/wiki/Conway%27s_Game_of_Life    

    Inputs:
        Plane: Grid base plane
        ExtendX: Number of grid cells in the base plane x-direction
        ExtendY: Number of grid cells in the base plane y-direction
        SizeX: Grid cell size in the base plane x-direction
        SizeY: Grid cell size in the base plane y-direction
        Max: Maximum number of generations
        Wrap: True to wrap the grid boundary, or False
            Wrapping means that grid cells that form the grid boundary
            look for neighbours beyond the boundary on the opposite side,
            basically like in the Asteroids game from 1979, where you
            could pass the screen boundary with you spaceship and pop 
            out on the opposite side
        Rec: True to record and output the full Game of Life history, 
            or False to only to output only the current generation
        Seed: Random seed for the initial setup of alive or dead cells
        Run: True to iterate the Game of Life, or False to pause it
        Reset: True to reset the Game of Life completely
    Output:
        Count: Current generation
        Cells: Grid cell outlines
        States: Current cell states (1 = alive, 0 = dead)
        Ages: Current cell ages"""


ghenv.Component.Name = "Conway's Game Of Life"
ghenv.Component.NickName = "GameOfLife"
ghenv.Component.Category = "User"
ghenv.Component.SubCategory = "CA"

############################## GAME OF LIFE ##################################

from ghpythonlib import treehelpers
from scriptcontext import sticky
import Rhino.Geometry as rg
import Grasshopper as gh
import random


__author__ = "p1r4t3b0y"
__email__ = "p1r4t3b0y@gmail.com"
__version__ = "0.6.3"


if Seed: random.seed(Seed)

class GameOfLife:
    """Conway's Game of Life Algorithm.
    
    Attributes:
        plane (Rhino.Geometry.Plane): A grid base plane.
        cols (int): A number of grid cells in the base plane x-direction.
        rows (int): A number of grid cells in the base plane y-direction.
        wrap (bool): True, or False to prevent wrapping. 
            Wrapping means that grid cells at the grid boundary will
            look for neighbours at the respective opposite grid sides.
    
    To use:
        >>> gl = GameOfLife(Rhino.Geometry.Plane(), 10, 10, True)
        >>> gl.setup()
        >>> gl.update()
        >>> grid = gl.draw_cells()
        >>> states = gl.get_states()
    """
    def __init__(self, plane, cols, rows, wrap):
        """Inits this Game of Life."""
        self.plane = plane
        self.cols = cols
        self.rows = rows
        self.wrap = wrap
        self.grid = dict()
        self.generation = 0
        self.curr_changes = 0
    
    
    def setup(self):
        """Sets this Game of Life up."""
        for y in xrange(self.rows):
            for x in xrange(self.cols):
                self.grid[x,y] = dict()
                self.grid[x,y]["state"] = random.randint(0, 1)
                self.grid[x,y]["nstate"] = None # next state
                self.grid[x,y]["nbours"] = self.get_neighbours(x,y,self.wrap)
                self.grid[x,y]["age"] = self.generation
        self.generation += 1
        self.curr_changes += 1
      
        
    def update(self, verbose=False):
        """Updates this Game of Life."""
        self.curr_changes = 0
        for y in xrange(self.rows):
            for x in xrange(self.cols):
                ncount = self.count_neighbours(x, y)
                if verbose: 
                    print "({},{}) -> {} neighbours".format(x,y,ncount)
                # Game of Life rules
                if self.get_state(x,y) == 0 and ncount == 2:
                    self.grid[x,y]["nstate"] = 1
                    self.curr_changes += 1
                elif self.get_state(x,y) == 1 and ncount > 2:
                    self.grid[x,y]["nstate"] = 0
                    self.grid[x,y]["age"] = 0 # reset the age
                    self.curr_changes += 1
                else:
                    self.grid[x,y]["age"] += 1
        # Set the cell states to the states of the current game iteration
        for y in xrange(self.rows):
            for x in xrange(self.cols):
                if self.grid[x,y]["nstate"] != None:
                    self.grid[x,y]["state"] = self.grid[x,y]["nstate"]
                    self.grid[x,y]["nstate"] = None
        self.generation += 1
    
        
    def get_neighbours(self, x, y, wrap=True):
            """Gets the neighbours of a cell in a grid of cells.
        
            Args:
              x (int): A x-position of the grid cell to find neighbours for.
              y (int): A y-position of the grid cell to find neighbours for.
              wrap (bool): Default True, or False to prevent wrapping. 
                Wrapping means that grid cells at the grid boundary will
                look for neighbours at the respective opposite grid sides.
            Returns:
              A list of neighbouring cells as tuples.
            """
            neighbours = []
            for i in xrange(-1, 2):
                for j in xrange(-1, 2):
                    col = (x + i + self.cols) % self.cols
                    row = (y + j + self.rows) % self.rows
                    if (x,y) != (col,row):
                        if wrap:
                            neighbours.append((col,row))
                        else:
                            if col <= x+1 and col >= x-1 \
                                and row <= y+1 and row >= y-1:
                                neighbours.append((col,row))
            return neighbours
    
    def count_neighbours(self, x, y):
        """Gets the number of live neighbours of a grid cell.
        
        Args:
          x (int): A x-position of the grid cell.
          y (int): A y-position of the grid cell.
        Returns:
          The integer number of live neighbours.
        """
        ncount = 0
        for neighbour in self.grid[x,y]["nbours"]:
            ncount += self.grid[neighbour[0],neighbour[1]]["state"]
        return ncount
    
    def get_state(self, x, y):
        """Returns the state of a grid cell, 1 for alive or 0 for dead."""
        return self.grid[x,y]["state"]
    
    def get_states(self):
        """Returns a nested list of cell states per grid row."""
        return [[self.get_state(x, y) for x in xrange(self.cols)] \
             for y in xrange(self.rows)]
   
    def draw_cells(self, xsize=1, ysize=1):
        """Draws the grid cells as rectangles in the world xy-plane,
            if no other base plane is provided for the grid.
        
        Args:
          xsize (float): A rectangle size in the x-direction of the grid.
          ysize (float): A rectangle size in the y-direction of the grid.
        Returns:
          A nested list of GH_Rectangles per grid row.
        """
        cells = []
        for y in xrange(self.rows):
            col_cells = []
            for x in xrange(self.cols):
                origin = rg.Point3d(x*xsize, y*ysize, 0) # plane origin
                if self.plane == (rg.Plane.WorldXY): # world xy-plane
                    pln = rg.Plane(origin, self.plane.XAxis, self.plane.YAxis)
                else: # remapped to other base plane
                    from_pln = rg.Plane.WorldXY # default grid plane
                    to_pt = self.plane.PointAt(origin.X, origin.Y, origin.Z)
                    pln = rg.Plane(to_pt, self.plane.XAxis, self.plane.YAxis)
                rect = rg.Rectangle3d(pln, xsize, ysize)
                col_cells.append(gh.Kernel.Types.GH_Rectangle(rect))
            cells.append(col_cells)
        return cells
    
    def get_age(self, x, y):
        """Returns the age of a grid cell."""
        return self.grid[x,y]["age"]
             
    def get_ages(self):
        """Returns a nested list of cell ages per grid row."""
        return [[self.get_age(x, y) for x in xrange(self.cols)] \
             for y in xrange(self.rows)]

##############################################################################

def update_component():
    """Updates this component, similar to using a Grasshopper timer."""
    # written by Anders Deleuran (andersholdendeleuran.com)
    def call_back(e):
        """Defines a callback action"""
        ghenv.Component.ExpireSolution(False)
    # Get the Grasshopper document
    ghDoc = ghenv.Component.OnPingDocument() 
    # Schedule this component to expire
    ghDoc.ScheduleSolution(1, \
        gh.Kernel.GH_Document.GH_ScheduleDelegate(call_back))

##############################################################################

if Plane == None: 
    Plane = rg.Plane.WorldXY
if ExtendX == None:
    ExtendX = 5
if ExtendY == None:
    ExtendY = 5
if SizeX == None:
    SizeX = 1.25
if SizeY == None:
    SizeY = 1.25
if Max == None:
    Max = float("inf")
if Wrap == None:
    Wrap = True
if Rec == None:
    Rec = False

if Reset and "GameOfLife" in sticky.keys():
    sticky.pop("GameOfLife", None)
    if "GLRecording" in sticky.keys():
        sticky.pop("GLRecording", None)
    ghenv.Component.Message = "Reset"

if Run:
    if not "GameOfLife" in sticky.keys():
        gl = GameOfLife(Plane, ExtendX, ExtendY, Wrap)
        gl.setup()
        sticky["GameOfLife"] = gl
        if Rec:
            sticky["GLRecording"] = [[], [], [], []]
            sticky["GLRecording"][0].append([gl.generation])
            sticky["GLRecording"][1].append(gl.draw_cells(SizeX, SizeY))
            sticky["GLRecording"][2].append(gl.get_states())
            sticky["GLRecording"][3].append(gl.get_ages())
    else:
        gl = sticky["GameOfLife"]
        if gl.curr_changes > 0 and gl.generation < Max:
            gl.update()
            sticky["GameOfLife"] = gl
            if Rec:
                sticky["GLRecording"][0].append([gl.generation])
                sticky["GLRecording"][1].append(gl.draw_cells(SizeX, SizeY))
                sticky["GLRecording"][2].append(gl.get_states())
                sticky["GLRecording"][3].append(gl.get_ages())
    
    if gl.curr_changes > 0 and gl.generation < Max:
        if Rec:
            ghenv.Component.Message = "Running + Recording"
        else:
            ghenv.Component.Message = "Running"
        update_component()
    else:
        ghenv.Component.Message = "Converged"
  
if "GameOfLife" in sticky.keys():
    gl = sticky["GameOfLife"]
    if not Run:
        if gl.curr_changes > 0 and gl.generation < Max:
            ghenv.Component.Message = "Paused"
        else:
            ghenv.Component.Message = "Converged"
    
    # Outputs
    if Rec:
        Count = treehelpers.list_to_tree(sticky["GLRecording"][0])
        Cells = treehelpers.list_to_tree(sticky["GLRecording"][1])
        States = treehelpers.list_to_tree(sticky["GLRecording"][2])
        Ages = treehelpers.list_to_tree(sticky["GLRecording"][3])
    else:
        Count = gl.generation
        Cells = treehelpers.list_to_tree(gl.draw_cells(SizeX, SizeY))
        States = treehelpers.list_to_tree(gl.get_states())
        Ages = treehelpers.list_to_tree(gl.get_ages())
# ---------- end gameoflife ----------
subtraction = Subtraction(A=gameoflife.Count, B=" 1")
tstat = TreeStatistics(Tree=gameoflife.States)  # -> Paths, Length, Count
item = ListItem(List=flatten(gameoflife.Count), Index=" -1", Wrap=True)
multiplication = Multiplication(A=subtraction, B=sizez)
item_2 = ListItem(List=tstat.Length, Index=0, Wrap=True)
generation = Panel(item)
dup = DuplicateData(Data=multiplication, Number=item_2, Order=True)  # -> graft(Data)
dup_2 = DuplicateData(Data=dup, Number=item_2, Order=True)  # -> simplify(Data)
item_3 = ListItem(List=flatten(gameoflife.Count), Index="-1", Wrap=True)
Z = UnitZ(Factor=dup_2)
move = Move(Geometry=simplify(gameoflife.Cells), Motion=Z)  # -> Geometry, Transform
dispatch = Dispatch(List=gameoflife.Ages, DispatchPattern=gameoflife.States)  # -> ListA, ListB
dispatch_2 = Dispatch(List=move.Geometry, DispatchPattern=gameoflife.States)  # -> ListA, ListB
clean = CleanTree(RemoveNulls=False, RemoveInvalid=False, RemoveEmpty=" True", Tree=dispatch_2.ListA)
remap = RemapNumbers(Value=dispatch.ListA, Source=item_3, Target=Domain(0, 1))  # -> Mapped, Clipped
clean_2 = CleanTree(RemoveNulls=False, RemoveInvalid=False, RemoveEmpty=" True", Tree=remap.Mapped)
boxrec = BoxRectangle(Rectangle=clean, Height=sizez)

# ---- group: Twn2Cols from Pufferfish
twn2cols = TweenTwoColors(
    ColorA=ColourSwatch(SwatchColor=RGB(255, 245, 245)),
    ColorB=ColourSwatch(SwatchColor=RGB(121, 72, 181)),
    Factor=clean_2,
    Alpha=True)

# ----
material = CreateMaterial(Diffuse=twn2cols, Specular=twn2cols, Emission=RGB(0, 0, 0), Transparency=0, Shine=1)
preview = CustomPreview(Geometry=boxrec, Material=material)
volume = MeshVolume(Mesh=boxrec)  # -> Volume, Centroid
pt = Point(volume.Centroid)
scale = Scale(Geometry=pt, Center=Point(0, 0, 0), Factor=Slider(0.1, range=0..1))  # -> Geometry, Transform
pt_2 = Point(simplify(Tree({0;0}: [Point(0.0625, 0.0625, 0.05), Point(0.4375, 0.0625, 0.05), Point(0.5625, 0.0625, 0.05), Point(0.6875, 0.0625, 0.05)], {0;1}: [Point(0.6875, 0.1875, 0.05), Point(0.8125, 0.1875, 0.05), Point(1.0625, 0.1875, 0.05)], {0;2}: [Point(0.1875, 0.3125, 0.05), Point(0.4375, 0.3125, 0.05), Point(0.6875, 0.3125, 0.05), Point(0.9375, 0.3125, 0.05), Point(1.0625, 0.3125, 0.05)], {0;3}: [Point(0.3125, 0.4375, 0.05), Point(0.4375, 0.4375, 0.05), Point(0.5625, 0.4375, 0.05), Point(0.8125, 0.4375, 0.05), Point(0.9375, 0.4375, 0.05), Point(1.1875, 0.4375, 0.05)], {0;4}: [Point(0.1875, 0.5625, 0.05), Point(0.3125, 0.5625, 0.05), Point(0.4375, 0.5625, 0.05), Point(0.6875, 0.5625, 0.05), Point(0.9375, 0.5625, 0.05)], {0;5}: [Point(0.1875, 0.6875, 0.05), Point(0.9375, 0.6875, 0.05), Point(1.1875, 0.6875, 0.05)]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)))
panel = Panel(pt_2)

xy = XYPlane(Origin=Point(0, 0, 0))
geo = Geometry(<brep referenced from the Rhino model>)
bbox = BoundingBox(Content=geo, Plane=xy, UnionBox=True)  # -> Box, Box_2
pop3d = Populate3D(Region=bbox.Box, Count=Slider(66, range=0..500), Seed=Slider(354, range=0..1000))
point = Point([Point(2.293052432, 1.559680807, 1.601704351), Point(1.574254096, 2.864006078, 2.921812634), Point(1.289187982, 1.002539448, 2.872641894), Point(1.510260171, 2.900209433, 1.007667366), Point(2.964728113, 2.835626537, 2.45593473), Point(2.198200155, 1.745750168, 2.8933703)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])
point_2 = Point(point)
point_3 = Point(pop3d)
deconstruct = Deconstruct(Point=point_3)  # -> XComponent, YComponent, ZComponent
deconstruct_2 = Deconstruct(Point=point_2)  # -> XComponent, YComponent, ZComponent
merge = Merge(
    Data1=graft(deconstruct.XComponent),
    Data2=graft(deconstruct.YComponent),
    Data3=graft(deconstruct.ZComponent),
    Data4=graft(deconstruct_2.XComponent),
    Data5=graft(deconstruct_2.YComponent),
    Data6=graft(deconstruct_2.ZComponent))  # -> simplify(Result)
flip_matrix = FlipMatrix(Data=merge)
center_box = CenterBox(Base=point_3, X=deconstruct_2.XComponent, Y=deconstruct_2.YComponent, Z=deconstruct_2.ZComponent)

tree_statistics = TreeStatistics(Tree=flip_matrix)  # -> Paths, Length, Count
预想分组数量 = Slider(3, range=0..30)
list_length = ListLength(List=tree_statistics.Paths)
bounds = Bounds(Numbers=flip_matrix)
series = Series(Start=0, Step=1, Count=list_length)  # -> graft(Series)
flip_matrix_2 = FlipMatrix(Data=flip_matrix)
random = Random(Range=bounds, Number=预想分组数量, Seed=series)  # -> simplify(Random)
flip_matrix_3 = FlipMatrix(Data=random)
list_length_2 = ListLength(List=flip_matrix_3)
list_length_3 = ListLength(List=flip_matrix_2)
construct_matrix = ConstructMatrix(Rows="1", Columns=list_length_3, Values=flip_matrix_2)  # -> simplify(Matrix)
construct_matrix_2 = ConstructMatrix(Rows="1", Columns=list_length_2, Values=flip_matrix_3)  # -> flatten(Matrix)

loop_start = LoopStart(Repeat=Slider(100, range=0..100), Trigger=Toggle(True), Data=construct_matrix_2, D1=construct_matrix)  # -> port, Counter, Data, Data_2
panel_2 = Panel(loop_start.Counter)

tree_statistics_2 = TreeStatistics(Tree=loop_start.Data_2)  # -> Paths, Length, Count
duplicate_data = DuplicateData(Data=loop_start.Data, Number=tree_statistics_2.Count, Order=True)
list_length_4 = ListLength(List=loop_start.Data)
duplicate_data_2 = DuplicateData(Data=loop_start.Data_2, Number=list_length_4, Order=True)  # -> simplify(Data)
partition_list = PartitionList(List=duplicate_data, Size=list_length_4)  # -> simplify(Chunks)

deconstruct_matrix = DeconstructMatrix(Matrix=duplicate_data_2)  # -> Rows, Columns, Values
deconstruct_matrix_2 = DeconstructMatrix(Matrix=partition_list)  # -> Rows, Columns, Values
expression = Expression(x=deconstruct_matrix.Values, y=deconstruct_matrix_2.Values, Expression="(x-y)^2")
mass_addition = MassAddition(Input=expression)  # -> Result, PartialResults
square_root = SquareRoot(Value=mass_addition.Result)  # -> simplify(Result)
trim_tree = TrimTree(Tree=square_root, Depth=1)

flatten_tree = FlattenTree(Tree=loop_start.Data_2, Path="{0}")
sort_list = SortList(Keys=trim_tree, ValuesValuesA=partition_list)  # -> Keys, ValuesValuesA
list_item = ListItem(List=sort_list.ValuesValuesA, Index=0, Wrap=True)
flatten_tree_2 = FlattenTree(Tree=list_item, Path="{0}")
create_set = CreateSet(List=flatten_tree_2)  # -> Set, Map
member_index = MemberIndex(Set=flatten_tree_2, Member=create_set.Set)  # -> Index, Count
list_item_2 = ListItem(List=flatten_tree, Index=member_index.Index, Wrap=True)
clean_tree = CleanTree(RemoveNulls=True, RemoveInvalid=True, RemoveEmpty=True, Tree=member_index.Index)  # -> simplify(Tree)
clean_tree_2 = CleanTree(RemoveNulls=True, RemoveInvalid=True, RemoveEmpty=True, Tree=list_item_2)  # -> simplify(Tree)

series_2 = Series(Start=loop_start.Counter, Step="-1", Count=Slider(1, range=0..10))
list_length_5 = ListLength(List=clean_tree_2)  # -> flatten(Length)
pi = Pi(Factor=1)
construct_path = ConstructPath(Indices=list_length_5)
text = Text(construct_path)
data_recorder = DataRecorder(text, DataLimit=-10, RecordData=True)
list_item_3 = ListItem(List=data_recorder, Index=series_2, Wrap=False)
replace_nulls = ReplaceNulls(Items=list_item_3, Replacements=pi)  # -> Items, Count
create_set_2 = CreateSet(List=replace_nulls.Items)  # -> Set, Map
list_length_6 = ListLength(List=create_set_2.Set)
equality = Equality(FirstNumber=list_length_6, SecondNumber="1")  # -> Equality, Inequality

deconstruct_matrix_3 = DeconstructMatrix(Matrix=simplify(clean_tree_2))  # -> Rows, Columns, simplify(Values)
path_mapper = PathMapper(deconstruct_matrix_3.Values, source="{A;B}(i)", target="{A;i}(b)")
average = Average(Input=path_mapper)  # -> simplify(ArithmeticMean)
list_length_7 = ListLength(List=deconstruct_matrix.Values)  # -> flatten(Length)
list_item_4 = ListItem(List=list_length_7, Index=0, Wrap=True)
trim_tree_2 = TrimTree(Tree=average, Depth=1)
construct_matrix_3 = ConstructMatrix(Rows="1", Columns=list_item_4, Values=trim_tree_2)  # -> flatten(Matrix)

loop_end = LoopEnd(
    port=loop_start.port,
    Exit=equality.Equality,
    Data=construct_matrix_3,
    Data_2=loop_start.Data_2,
    TimeOutVal=0,
    pausedState=False,
    state="Constant output")  # -> Data, D1
integer = Integer(clean_tree)
list_item_5 = ListItem(List=center_box, Index=integer, Wrap=True)
tree_statistics_3 = TreeStatistics(Tree=list_item_5)  # -> Paths, Length, Count
range = Range(Domain=Domain(0, 1), Steps=tree_statistics_3.Count)
cull_index = CullIndex(List=range, Indices=0, Wrap=True)
colour_hsl = ColourHSL(Alpha=1, Hue=cull_index, Saturation=1, Luminance=0.5)  # -> simplify(graft(Colour))
custom_preview = CustomPreview(Geometry=list_item_5, Material=colour_hsl)
matrix = Matrix(clean_tree_2)
