# Grasshopper definition WFC_Generation.gh (Grasshopper 1.0.7)
# plug-ins: Monoceros

geo = Geometry(<brep referenced from the Rhino model>)
geo_2 = Geometry(<brep referenced from the Rhino model>)
geo_3 = Geometry(<brep referenced from the Rhino model>)
geo_4 = Geometry(<brep referenced from the Rhino model>)
geo_5 = Geometry(<brep referenced from the Rhino model>)
mesh = Mesh(geo_3)
mesh_2 = Mesh(geo)
mesh_3 = Mesh(geo_5)
mesh_4 = Mesh(geo_2)
mesh_5 = Mesh(geo_4)
vec = VectorXYZ(XComponent="0.5", YComponent="0.25", ZComponent="1")  # -> Vector, Length
cluster = Cluster(color=ColourSwatch(SwatchColor=RGBA(91, 100, 133, 200)), mesh=mesh_4, light=vec.Vector)  # -> flatten(mesh_2)
cluster_2 = Cluster(color=ColourSwatch(SwatchColor=RGBA(253, 212, 122, 200)), mesh=mesh_5, light=vec.Vector)  # -> flatten(mesh_2)
cluster_3 = Cluster(color=ColourSwatch(SwatchColor=RGBA(140, 178, 131, 200)), mesh=mesh_2, light=vec.Vector)  # -> flatten(mesh_2)
cluster_4 = Cluster(color=ColourSwatch(SwatchColor=RGBA(243, 127, 78, 200)), mesh=mesh, light=vec.Vector)  # -> flatten(mesh_2)
cluster_5 = Cluster(color=ColourSwatch(SwatchColor=RGBA(162, 177, 191, 199)), mesh=mesh_3, light=vec.Vector)  # -> flatten(mesh_2)
entwine = Entwine(Branch00=cluster_4, Branch01=cluster_2, Branch02=cluster_3, Branch03=cluster_5, Branch04=cluster, FlattenInputs=True)  # -> simplify(Result)
geo_6 = Geometry(entwine)

number_slider = Slider(4, range=0..10)
number_slider_2 = Slider(5, range=0..10)
pt = ConstructPoint(XCoordinate=number_slider, YCoordinate=number_slider, ZCoordinate=0)
series = Series(Start=0, Step=1, Count=Slider(7, range=0..10))
sqgrid = Square(Plane=pt, Size=1, ExtentX=number_slider_2, ExtentY=number_slider_2)  # -> Cells, Points
graft = GraftTree(Tree=series, IncludeEmptyLists=True, IncludeNullItems=True)
Z = UnitZ(Factor=graft)
flatten = FlattenTree(Tree=sqgrid.Points, Path="{0}")
move = Move(Geometry=flatten, Motion=Z)  # -> Geometry, Transform
slotall = ConstructSlotWithAllModulesAllowed(SlotPoint=move.Geometry, BasePlane=PlaneXY(0, 0, 0), GridSlotDiagonal=Vector(1, 1, 1))

group = Group(Objects=geo_6)  # -> flatten(Group)
lng = ListLength(List=group)
series_2 = Series(Start=0, Step=1, Count=lng)
concat = Concatenate(FragmentA="module", FragmentB=series_2)
graft_2 = GraftTree(Tree=concat, IncludeEmptyLists=True, IncludeNullItems=True)

number_slider_3 = Slider(2, range=0..10)
series_3 = Series(Start=number_slider_3, Step=number_slider_3, Count=Slider(5, range=0..10))
number_slider_4 = Slider(0.5, range=0..1)
pt_2 = ConstructPoint(XCoordinate=series_3, YCoordinate=0, ZCoordinate=0)
graft_3 = GraftTree(Tree=pt_2, IncludeEmptyLists=True, IncludeNullItems=True)  # -> simplify(Tree)
box = CenterBox(Base=pt_2, X=number_slider_4, Y=Slider(0.5, range=0..1), Z=number_slider_4)

debrep = DeconstructBrep(Brep=box)  # -> Faces, Edges, Vertices
area = Area(Geometry=debrep.Faces)  # -> Area, Centroid

# ----
# DD
# DE
# CE
# CD
# BE
# EE
panel = Panel("""1
3
0
4""")
panel_2 = Panel("""4
0
3
1""")
panel_3 = Panel("module4")
panel_4 = Panel("module1")
ruleexp = ConstructExplicitRule(SourceModuleName="module3", SourceConnectorIndex=panel, TargetModuleName="module4", TargetConnectorIndex=panel_2)
ruleexp_2 = ConstructExplicitRule(SourceModuleName="module2", SourceConnectorIndex=panel, TargetModuleName="module4", TargetConnectorIndex=panel_2)
ruleexp_3 = ConstructExplicitRule(SourceModuleName="module2", SourceConnectorIndex=panel, TargetModuleName="module3", TargetConnectorIndex=panel_2)
ruleexp_4 = ConstructExplicitRule(SourceModuleName="module4", SourceConnectorIndex=panel, TargetModuleName="module4", TargetConnectorIndex=panel_2)
ruleexp_5 = ConstructExplicitRule(SourceModuleName="module3", SourceConnectorIndex=panel, TargetModuleName="module3", TargetConnectorIndex=panel_2)
merge = Merge(Data1=ruleexp_5, Data2=ruleexp, Data3=ruleexp_2, Data4=ruleexp_3, Data6=ruleexp_4)

moduleempty = ConstructEmptyModule(BasePlane=PlaneXY(0, 0, 0), ModulePartDiagonal=Vector(1, 1, 1))  # -> Module, Rules
constmodule = ConstructModule(
    ModuleName=graft_2,
    ModulePartPoints=graft_3,
    Geometry=geo_6,
    BasePlane=PlaneXY(0, 0, 0),
    ModulePartDiagonal=Vector(1, 1, 1))
merge_2 = Merge(Data1=moduleempty.Module, Data2=constmodule)
flatten_2 = FlattenTree(Tree=merge_2, Path="{0}")

ruleindiffunused = IndifferentRulesForUnusedConnectors(Module=flatten_2)
flatten_3 = FlattenTree(Tree=merge, Path="{0}")
merge_3 = Merge(Data1=ruleindiffunused)

flatten_4 = FlattenTree(Tree=merge_3, Path="{0}")
collectrules = CollectRules(Modules=flatten_2, RulesAllowed=flatten_4, ExplicitRulesDisallowed=flatten_3)

flatten_5 = FlattenTree(Tree=collectrules, Path="{0}")
flatten_6 = FlattenTree(Tree=slotall, Path="{0}")
flatten_7 = FlattenTree(Tree=flatten_2, Path="{0}")
wfc = MonocerosWFCSolver(
    Slots=flatten_6,
    Modules=flatten_7,
    Rules=flatten_5,
    RandomSeed=Slider(382, range=0..1000),
    MaxAttempts=10,
    MaxObservations=2147483647,
    MaxTime=0,
    UseShannonEntropy=False)  # -> Out, Slots, Deterministic, Contradictory, Seed, Attempts, Observations
materialize = MaterializeSlots(Modules=flatten_2, Slots=wfc.Slots)  # -> Geometry, Transform

geo_7 = Geometry(materialize.Geometry)

# ==== cluster Cluster
color = ClusterInput()
mesh = ClusterInput()
light = ClusterInput()
demesh = DeconstructMesh(Mesh=mesh)  # -> Vertices, Faces, Colours, Normals
unit = UnitVector(Vector=light)
dprod = DotProduct(VectorA=demesh.Normals, VectorB=unit, Unitize=False)
remap = RemapNumbers(Value=dprod, Source=Domain(-1, 1), Target=Domain(0, 1))  # -> Mapped, Clipped
graft = GraftTree(Tree=mesh, IncludeEmptyLists=True, IncludeNullItems=True)
multiplication = Multiplication(A=color, B=remap.Mapped)
mcol = MeshColours(Mesh=graft, Colours=multiplication)
mesh_2 = ClusterOutput(mcol)
