# Grasshopper definition WFC_Python.gh (Grasshopper 1.0.7)

brep = Brep(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)
brep_2 = Brep(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)
brep_3 = Brep(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)
# Connections are labelled clockwise, starting from 12 O’Clock
# 
# 0 is agnostic
# 1 is plug
# 2 is socket
brep_4 = Brep(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)
brep_5 = Brep(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)
brep_6 = Brep(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)
brep_7 = Brep(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)
brep_8 = Brep(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)
brep_9 = Brep(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)
brep_10 = Brep(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)
brep_11 = Brep(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)
brep_12 = Brep(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)
cluster = Cluster(geometry=brep_4, edges="A, A, A, A", type="0,0,0,0")
cluster_2 = Cluster(geometry=brep_5, edges="B, C, B, A", type="1,0,2,0")
cluster_3 = Cluster(geometry=brep_6, edges="D, E, A, E", type="0,1,0,2")
cluster_4 = Cluster(geometry=brep_7, edges="D, D, D, D", type="0,0,0,0")
cluster_5 = Cluster(geometry=brep_8, edges="D, F, B, E", type="0,1,2,2")
cluster_6 = Cluster(geometry=brep_9, edges="C, C, G, F", type="0,0,2,1")
cluster_7 = Cluster(geometry=brep, edges="C, C, C, C", type="0,0,0,0")
cluster_8 = Cluster(geometry=brep_10, edges="A, A, B, B", type="0,0,1,2")
cluster_9 = Cluster(geometry=brep_2, edges="G, F, C, F", type="0,1,0,2")
cluster_10 = Cluster(geometry=brep_11, edges="C, C, G, G", type="0,0,2,1")
cluster_11 = Cluster(geometry=brep_3, edges="G, C, G, D", type="1,0,2,0")
cluster_12 = Cluster(geometry=brep_12, edges="H, F, C, C", type="2,1,0,0")
merge = Merge(
    Data1=cluster,
    Data2=cluster_2,
    Data3=cluster_3,
    Data4=cluster_4,
    Data5=cluster_5,
    Data6=cluster_6,
    Data7=cluster_7,
    Data8=cluster_8,
    Data9=cluster_9,
    Data10=cluster_10,
    Data11=cluster_11,
    Data12=cluster_12)
python = GhPythonScript(modules=merge)  # -> out; inputs modules: list
# ---------- python: Python ----------
__author__ = "alasdairmott"

import rhinoscriptsyntax as rs

maximum = 'A'

for m in modules:
    edges = m.edges
    for e in edges:
        maximum = max(e[0], maximum)
        
print "Up to Joint", maximum
# ---------- end python ----------
number_slider = Slider(6, range=0..10)
panel = Panel(python)

# ---- group: rotation
python_2 = GhPythonScript(modules=merge, allow_rotation=Toggle(True), allow_reflection=Toggle(True))  # -> out, modules; inputs modules: list
# ---------- python_2: Python ----------
import Rhino
from math import pi

class Module:
    def __init__(self, geo, edges):
        self.geometry = geo
        #e = [e.strip() for e in edges.split(',')]
        #e_t = [int(e_t) for e_t in type.split(',')]
        self.edges = edges
        #self.edges = [(e[i],e_t[i]) for i in range(4)]
        self.origin = self.geometry.GetBoundingBox(True).Min

augmented_modules = []
if allow_reflection:
    augmented_modules.extend(modules)
    for m in modules:
        #print m.edges
        
        edges = [(m.edges[0][0], m.edges[0][1]*2 % 3),\
                 (m.edges[3][0], m.edges[3][1]*2 % 3),\
                 (m.edges[2][0], m.edges[2][1]*2 % 3),\
                 (m.edges[1][0], m.edges[1][1]*2 % 3)]
        #edges = m.edges
        
        #print edges
        #print 
        
        geo = m.geometry.DuplicateBrep()
        
        xy = Rhino.Geometry.Plane.WorldYZ
        xy.Origin = geo.GetBoundingBox(False).Center
        t = Rhino.Geometry.Transform.Mirror(xy)
        
        geo.Transform(t)
        augmented_modules.append(Module(geo, edges))
        
    modules = augmented_modules

augmented_modules = []
if allow_rotation:
    for m in modules:
        for i in range(4):
            
            #edges_rotated = list(m.edges[-i:] + m.edges[:-i])
            edges_rotated = list(m.edges[-i:] + m.edges[:-i])
            geo = m.geometry.DuplicateBrep()

            t = Rhino.Geometry.Transform.Rotation(-pi/2*i,  Rhino.Geometry.Vector3d.ZAxis, geo.GetBoundingBox(False).Center)
            geo.Transform(t)
            augmented_modules.append(Module(geo, edges_rotated))


    modules = augmented_modules
# ---------- end python_2 ----------

# ----
sqgrid = Square(Plane=PlaneXY(0, 0, 0), Size="10", ExtentX=number_slider, ExtentY=number_slider)  # -> Cells, Points

# ---- group: WFC
python_3 = GhPythonScript(grid=sqgrid.Cells, modules=python_2.modules, steps=Slider(620, range=0..1000), seed=Slider(81, range=0..100))  # -> out, geometry, text; inputs grid: tree of Rectangle3d, modules: list, steps: Int32
# ---------- python_3: Python ----------
__author__ = "alasdairmott"

s = 0

#import rhinoscriptsyntax as rs
import Rhino
import random
from math import pi

random.seed(seed)

Ex = grid.BranchCount
Ey = len(grid.Branches[0])

size_x = grid.Branches[0][0].Width
size_y = grid.Branches[0][0].Height

class Module:
    def __init__(self, geo, edges, type):
        self.geometry = geo
        e = [e.strip() for e in edges.split(',')]
        e_t = [int(e_t) for e_t in type.split(',')]
        
        self.edges = [(e[i],e_t[i]) for i in range(4)]
        self.origin = self.geometry.GetBoundingBox(Rhino.Geometry.Plane.WorldXY).Min

class Cell:
    def __init__(self, grid, coords, modules):
        self.grid_instance = grid
        self.coordinates = coords
        self.modules = set(modules)
        
        self.neighbouring_coords = self.getNeighbouring_coords()
    
    def getBorder(self, i):
        edges = set()
                
        for m in self.modules:
            edges.add(m.edges[i])
            
        return edges
    
    def getNeighbouring_coords(self):
        x, y = self.coordinates[0], self.coordinates[1]
        coords = []
                
        if y < self.grid_instance.Ey-1: coords.append((x, y+1))
        else: coords.append((None, None))
        if x < self.grid_instance.Ex-1: coords.append((x+1, y))
        else: coords.append((None, None))
        if y > 0: coords.append((x, y-1))
        else: coords.append((None, None))
        if x > 0: coords.append((x-1, y))
        else: coords.append((None, None))
        return coords
    
    def collapse(self):
        #Choose a module from the remaining modules
        m = list(self.modules)[random.randint(0,len(self.modules)-1)]
        self.modules = {m}
        
        g = m.geometry.DuplicateBrep()
        pt = Rhino.Geometry.Point3d(self.coordinates[0]*self.grid_instance.size_x, \
                                    self.coordinates[1]*self.grid_instance.size_y, 0)
        v = Rhino.Geometry.Vector3d(pt-m.origin)
        t = Rhino.Geometry.Transform.Translation(v)
        g.Transform(t)
        
        self.geometry = g
        
class Grid:
    def __init__(self, ex, ey, sx, sy, modules):
        global s
        
        self.Ex = ex
        self.Ey = ey
        self.size_x = sx
        self.size_y = sy
        
        self.initilise_grid()
  
        #Choose a random cell to collapse
        while len(self.uncertain) > 0:
            print 'Uncertain cells remaining:', len(self.uncertain)
            
            s += 1
            if s > steps: return
        
            x, y = list(self.uncertain)[random.randint(0,len(self.uncertain)-1)]
            print 'Collapsing cell:', x, y
        
            self.grid[x][y].collapse()
            self.propogate(x,y)
            
            if self.contradiction: self.initilise_grid()
                
        
        print ('WFC complete')
    
    def initilise_grid(self):
        #Set up grid
        self.grid = []
        for i in range(self.Ex):
            row = []
            for j in range(self.Ey):
                cell = Cell(self, (i,j), modules)
                row.append(cell)
            self.grid.append(row)
        
        self.uncertain = set()
        [[self.uncertain.add((i,j)) for j in range(self.Ey)] for i in range(self.Ex)]
        
        self.contradiction = False
        
    
    def propogate(self, x,y):
        global s
        s += 1
        if s > steps: return
        
        #if s > steps -3: print 'coords', (x,y)
        
        neighbouring_coords = self.grid[x][y].neighbouring_coords
        
        for i, (x_n,y_n) in enumerate(neighbouring_coords):
            if (x_n,y_n) == (None, None): continue

            neighbour = self.grid[x_n][y_n]
            
            edges_neighour = neighbour.getBorder((i+2)%4)
            edges_cell     = self.grid[x][y].getBorder(i)
            
            #First update based on neighbours. keep only edges_cell that are in edges_neighour
            #print ['N', 'E', 'S', 'W'][i], 'cell:', edges_cell, 'neighbour:', edges_neighour
            
            for e in edges_cell:
                e_opposite = e[0], e[1]*2%3
                #print 'e', e, 'e_opposite', e_opposite
                if e_opposite not in edges_neighour:
                    #remove the possibilities that rely on this
                    
                    reliant_modules = set() #modules with e as the ith edge
                    for m in self.grid[x][y].modules:
                        if m.edges[i] == e:
                            reliant_modules.add(m)
                    
                    self.grid[x][y].modules -= reliant_modules
                                        
            #Now check if neighbour needs to be propograted
            for e_n in edges_neighour:
                e_n_opposite = e_n[0], e_n[1]*2%3
                #print 'e_n', e_n, 'e_n_opposite', e_n_opposite
                if e_n_opposite not in edges_cell:
                    effects = self.propogate(x_n, y_n)
            

        #if cell has only one option left, remove it from list of uncertain modules
        if len(self.grid[x][y].modules) == 0:
            print 'unresolvable state reached'
            self.contradiction = True
        
        if len(self.grid[x][y].modules) == 1:
            self.uncertain -= {(x,y)}
            #pass
        
    def getGeometry(self):
        self.geo = []
        self.text = []
        for i in range(self.Ex): 
            for j in range(self.Ey):
                m = self.grid[i][j]
                possibilities_count = len(m.modules)
                if possibilities_count == 1: 
                    m.collapse()
                    self.geo.append(m.geometry)
                else: self.text.append(((i*self.size_x, j*self.size_y, 0), possibilities_count))
                    

                   
grid = Grid(Ex, Ey, size_x, size_y, modules)
grid.getGeometry()

geometry = grid.geo
text = grid.text
# ---------- end python_3 ----------

# ----
preview = CustomPreview(
    Geometry=python_3.geometry,
    Material={diffuse=RGB(182, 191, 202), emission=RGB(76, 76, 76), shine=0.5, specular=RGB(255, 255, 255), transparency=0})

# ---- group: Number of Possibilites Remaining
python_4 = GhPythonScript(text=python_3.text)  # -> L, T
# ---------- python_4: Python ----------
import Rhino

pt = text[0]
L = Rhino.Geometry.Point3d(pt[0], pt[1], pt[2])
T = text[1]
# ---------- end python_4 ----------
tag = TextTag3D(Location=python_4.L, Text=python_4.T, Size=1, Justification=7)

# ----
panel_2 = Panel(python_3.out)

# ==== cluster Cluster
type = ClusterInput()
geometry = ClusterInput()
edges = ClusterInput()
python = GhPythonScript(geometry=geometry, edges=edges, type=type)  # -> out, module; inputs geometry: Brep
# ---------- python: Python ----------
__author__ = "alasdairmott"

class Module:
    def __init__(self, geo, edges, type):
        self.geometry = geo
        e = [e.strip() for e in edges.split(',')]
        e_t = [int(e_t) for e_t in type.split(',')]
        
        self.edges = [(e[i],e_t[i]) for i in range(4)]
        self.origin = self.geometry.GetBoundingBox(False).Min

module = Module(geometry, edges, type)
# ---------- end python ----------
panel = Panel(python.out)
module = ClusterOutput(python.module)
